# Grasshopper definition rhino_animation.gh (Grasshopper 1.0.7)
# plug-ins: Anemone, HFTidyCanvas, CORE.Toolbox.Grasshopper, BullAnt, EleFront

panel = Panel("""Plugins
- Elefront
- TTtoolbox
- Bullant (GeometryGym)""")
folder_path = DataDescription("C:\Users\mbide\Desktop\AECtech Hackaton\")

number_slider = Slider(401, range=0..1000)
toggle = Toggle(Toggle(False))
scaling_factor = Pts(Slider(2, range=0..10))
iterations = DataDescription(Slider(0, range=0..100))

panel_2 = Panel("""15
16
29
30
31
32
33
34""")
node_num_to_delete_etabs_auto_generate = NodeNum(panel_2)

concat = Concatenate(FragmentA=folder_path, FragmentB="geometry.xlsx")
concat_2 = Concatenate(FragmentA=folder_path, FragmentB="geometry.xlsx")
concat_3 = Concatenate(FragmentA=folder_path, FragmentB="geometry.xlsx")
concat_4 = Concatenate(FragmentA=folder_path, FragmentB="geometry.xlsx")
concat_5 = Concatenate(FragmentA=folder_path, FragmentB="TimeHistoryDispOutput.xlsx")
xl_in = ReadFromExcel(WorkbookFilepath=concat, WorksheetName="Point Object Connectivity", Range="4", Live=False, Stream=Toggle(True))
storey_height = Pts("3.6")
xl_in_2 = ReadFromExcel(WorkbookFilepath=concat_4, WorksheetName="Beam Object Connectivity", Range="4", Live=False, Stream=Toggle(True))
xl_in_3 = ReadFromExcel(WorkbookFilepath=concat_3, WorksheetName="Column Object Connectivity", Range="4", Live=False, Stream=Toggle(True))
xl_in_4 = ReadFromExcel(WorkbookFilepath=concat_2, WorksheetName="Brace Object Connectivity", Range="4", Live=False, Stream=Toggle(True))
xl_in_5 = ReadFromExcel(WorkbookFilepath=concat_5, WorksheetName="Time History Plot", Range="4", Live=False, Stream=Toggle(True))
time_step = Pts("0.1")
xl_in_6 = ReadFromExcel(
    WorkbookFilepath="C:\Users\mbide\Desktop\AECtech Hackaton\FrameSec.xlsx",
    WorksheetName="frameSec",
    Range="4",
    Live=False,
    Stream=Toggle(True))
flip = FlipMatrix(Data=xl_in)
flip_2 = FlipMatrix(Data=xl_in_4)
flip_3 = FlipMatrix(Data=xl_in_3)
flip_4 = FlipMatrix(Data=xl_in_2)
flip_5 = FlipMatrix(Data=xl_in_6)
replace = ReplaceItems(List=xl_in_5, Item="0", Indices="0", Wrap=False)
split = SplitList(List=flip, Index="3")  # -> ListA, ListB
split_2 = SplitList(List=flip_2, Index="3")  # -> ListA, ListB
split_3 = SplitList(List=flip_3, Index="3")  # -> ListA, ListB
split_4 = SplitList(List=flip_4, Index="3")  # -> ListA, ListB
split_5 = SplitList(List=flip_5, Index="1")  # -> ListA, ListB
flip_6 = FlipMatrix(Data=split.ListB)
flip_7 = FlipMatrix(Data=replace)
flip_8 = FlipMatrix(Data=split_2.ListB)
flip_9 = FlipMatrix(Data=split_3.ListB)
flip_10 = FlipMatrix(Data=split_4.ListB)
flip_11 = FlipMatrix(Data=split_5.ListB)
item = ListItem(List=flip_6, Index="0", Wrap=True)
item_2 = ListItem(List=flip_6, Index="6", Wrap=True)
item_3 = ListItem(List=flip_6, Index="7", Wrap=True)
item_4 = ListItem(List=flip_6, Index="5", Wrap=True)
split_6 = SplitList(List=flip_7, Index="3")  # -> ListA, ListB
item_5 = ListItem(List=flip_11, Index="0", Wrap=True)
item_6 = ListItem(List=flip_9, Index="3", Wrap=True)
item_7 = ListItem(List=flip_9, Index="4", Wrap=True)
item_8 = ListItem(List=flip_11, Index="1", Wrap=True)
item_9 = ListItem(List=flip_9, Index="0", Wrap=True)
item_10 = ListItem(List=flip_8, Index="4", Wrap=True)
item_11 = ListItem(List=flip_10, Index="3", Wrap=True)
item_12 = ListItem(List=flip_8, Index="3", Wrap=True)
item_13 = ListItem(List=flip_10, Index="4", Wrap=True)
item_14 = ListItem(List=flip_8, Index="0", Wrap=True)
item_15 = ListItem(List=flip_10, Index="0", Wrap=True)
node_y_coord = DataDescription(flatten(item_2))
node_x_coord = DataDescription(flatten(item_4))
node_z_coord = DataDescription(flatten(item_3))
displ_of_each_floor_in_mm = Pts(split_6.ListB)
node_num = DataDescription(flatten(item))
node_num_to_delete_etabs_auto_generate_2 = NodeNumToDeleteETABSAutoGenerate(node_num_to_delete_etabs_auto_generate)
beam_num = Pts(item_5)
node2 = Pts(item_7)
profile = Pts(item_8)
node1 = Pts(item_6)
node1_2 = Pts(item_12)
beam_num_2 = Pts(item_14)
beam_num_3 = Pts(item_9)
beam_num_4 = Pts(item_15)
node2_2 = Pts(item_10)
node1_3 = Pts(item_11)
node2_3 = Pts(item_13)
pt = ConstructPoint(XCoordinate=node_x_coord, YCoordinate=node_y_coord, ZCoordinate=node_z_coord)
node_num_2 = NodeNum(flatten(node_num))
pts_in_ft = NodeNum(pt)
node_num_3 = NodeNum(node_num)
mindex = MemberIndex(Set=node_num_2, Member=node_num_to_delete_etabs_auto_generate_2)  # -> flatten(Index), Count
node2_4 = Node2(node2_2)
beam_num_5 = BeamNum(beam_num_3)
node1_4 = Node1(node1_2)
node2_5 = Node2(node2)
beam_num_6 = BeamNum(beam_num_4)
beam_num_7 = BeamNum(beam_num_2)
node2_6 = Node2(node2_3)
node1_5 = Node1(node1)
node1_6 = Node1(node1_3)
multiplication = Multiplication(A=pts_in_ft, B="0.3048")
merge = Merge(Data1=node2_6, Data2=node2_4, Data3=node2_5)  # -> flatten(Result)
merge_2 = Merge(Data1=beam_num_4, Data2=beam_num_7, Data3=beam_num_5)  # -> flatten(Result)
merge_3 = Merge(Data1=node1_6, Data2=node1_4, Data3=node1_5)  # -> flatten(Result)
index_to_cull = NodeNum(mindex.Index)
pts = Pts(multiplication)
storey_height_2 = StoreyHeight(storey_height)
index_to_cull_2 = IndexToCull(index_to_cull)
index_to_cull_3 = IndexToCull(index_to_cull)
beam_num_8 = BeamNum(merge_2)
node2_7 = Node2(merge)
node1_7 = Node1(merge_3)
cull_i = CullIndex(List=pts, Indices=index_to_cull_2, Wrap=True)
cull_i_2 = CullIndex(List=node_num_3, Indices=index_to_cull_3, Wrap=True)
series = Series(Start="0", Step=storey_height_2, Count="10")
pts_2 = Pts(cull_i)
node_num_4 = NodeNum(cull_i_2)
shift = ShiftList(List=series, Shift=1, Wrap=False)
pdecon = Deconstruct(Point=pts_2)  # -> XComponent, YComponent, ZComponent
pts_3 = Pts(pts_2)
dom = ConstructDomain(DomainStart=series, DomainEnd=shift)
cull_i_3 = CullIndex(List=reverse(dom), Indices="0", Wrap=True)  # -> reverse(List)
z_coord = DataDescription(pdecon.ZComponent)
displ_of_each_floor_in_mm_2 = DisplOfEachFloor(displ_of_each_floor_in_mm)
node_domains = DataDescription(cull_i_3)
node_domains_2 = NodeDomains(node_domains)
z_coord_2 = DataDescription(z_coord)
multiplication_2 = Multiplication(A=displ_of_each_floor_in_mm_2, B=Slider(0.001, range=0..0.001))
inc = Includes(Value=flatten(z_coord_2), Domain=graft(node_domains_2))  # -> Includes, Deviation
node_num_5 = NodeNum(node_num_4)
node_domains_3 = NodeDomains(node_domains)
displ_of_each_floor_in_m = DisplOfEachFloor(multiplication_2)
in_domain = DataDescription(inc.Includes)
pts_4 = Pts(pts_3)
in_domain_2 = InDomain(inc.Includes)
node_num_6 = NodeNum(node_num_5)
dispatch = Dispatch(List=pts_4, DispatchPattern=in_domain)  # -> ListA, ListB
dispatch_2 = Dispatch(List=pts_4, DispatchPattern=in_domain)  # -> ListA, ListB
dispatch_3 = Dispatch(List=node_num_6, DispatchPattern=in_domain_2)  # -> ListA, ListB
pts_by_floor = Pts(dispatch.ListA)
pts_by_floor_2 = Pts(dispatch_2.ListA)
node_num_by_floor = NodeNum(dispatch_3.ListA)
toggle_2 = Toggle(toggle)
scaling_factor_2 = ScalingFactor(scaling_factor)
iterations_2 = Iterations(iterations)
node_num_by_floor_2 = NodeNumByFloor(node_num_by_floor)
displ_of_each_floor_in_m_2 = DisplOfEachFloorInM(displ_of_each_floor_in_m)
time_step_2 = TimeStep(time_step)
pts_by_floor_3 = PtsByFloor(pts_by_floor)
pts_by_floor_4 = Pts(pts_by_floor_2)
node2_8 = Node2(merge)
node1_8 = Node1(merge_3)
beam_num_9 = BeamNum(merge_2)
node_domains_4 = NodeDomains(node_domains_3)
displ_of_each_floor_in_m_3 = DisplOfEachFloorInM(displ_of_each_floor_in_m)
iterations_3 = Iterations(iterations_2)
toggle_3 = Toggle(toggle_2)
scaling_factor_3 = ScalingFactor(scaling_factor_2)
pts_by_floor_5 = PtsByFloor(pts_by_floor_3)
displ_of_each_floor_in_m_4 = DisplOfEachFloorInM(displ_of_each_floor_in_m_2)
toggle_4 = Toggle(toggle_3)
iterations_4 = Iterations(iterations_3)
scaling_factor_4 = ScalingFactor(scaling_factor_3)
pts_by_floor_6 = Pts(pts_by_floor_2)
pts_by_floor_7 = Pts(pts_by_floor_6)
loop_start = LoopStart(Repeat=iterations_4, Trigger=toggle_4, Data=pts_by_floor_5)  # -> port, Counter, Data
multiplication_3 = Multiplication(A=displ_of_each_floor_in_m_4, B=scaling_factor_4)
pts_by_floor_8 = Pts(pts_by_floor_4)
X = UnitX(Factor=multiplication_3)
node_num_by_floor_3 = NodeNumByFloor(node_num_by_floor_2)
pdecon_2 = Deconstruct(Point=flatten(pts_by_floor_7))  # -> XComponent, YComponent, ZComponent
counter = TimeS(loop_start.Counter)
pts_by_floor_9 = PtsByFloor(loop_start.Data)
time_step_3 = TimeStep(time_step_2)
division = Division(A=counter, B=10)
pts_by_floor_10 = PtsByFloor(pts_by_floor_9)
sort = SortList(Keys=reverse(flatten(pdecon_2.ZComponent)), ValuesA=flatten(pts_by_floor_7))  # -> Keys, ValuesA
counter_2 = Counter(counter)
x_displ = DisplOfEachFloorInM(X)
panel_3 = Panel(counter)
concat_6 = Concatenate(FragmentA=division, FragmentB="s")
item_16 = ListItem(List=x_displ, Index=counter_2, Wrap=True)
replace_2 = ReplaceMembers(Set=pts_by_floor_10, Find=pts_by_floor_10, Replace=pts_by_floor_8)
item_17 = ListItem(List=sort.ValuesA, Index=0, Wrap=True)
displ = DisplOfEachFloorInM(item_16)
X_2 = UnitX(Factor="3")
move = Move(Geometry=replace_2, Motion=item_16)  # -> Geometry, Transform
time_step_4 = TimeStep(time_step_3)
move_2 = Move(Geometry=item_17, Motion=X_2)  # -> Geometry, Transform
time_step_5 = TimeStep(time_step_4)
text = Text(concat_6)
xz = XZPlane(Origin=move_2.Geometry)
buffer = TimeBuffer(Data=move.Geometry, Ms=time_step_5, UseThread=False)
plane = Plane(xz)
displ_of_each_floor_in_m_5 = DisplOfEachFloorInM(displ_of_each_floor_in_m_3)
node_num_by_floor_4 = NodeNumByFloor(flatten(node_num_by_floor_3))
text_2 = DefineText(Text=text, Plane=plane, Size=180, Font="Arial", JustificationMode=65537)
pts_by_floor_11 = PtsByFloor(move.Geometry)
node1_9 = Node1(node1_8)
node1_10 = Node1(node1_9)
node_num_by_floor_5 = NodeNumByFloor(flatten(node_num_by_floor_4))
node2_9 = Node2(node2_8)
loop_end = LoopEnd(port=loop_start.port, Exit=False, Data=pts_by_floor_11, TimeOutVal=0, pausedState=False, state="Constant output")
pts_by_floor_12 = PtsByFloor(flatten(pts_by_floor_11))
mindex_2 = MemberIndex(Set=node_num_by_floor_4, Member=node1_10)  # -> flatten(Index), Count
node_domains_5 = NodeDomains(node_domains_4)
beam_num_10 = BeamNum(beam_num_9)
displ_of_each_floor_in_m_6 = DisplOfEachFloorInM(displ_of_each_floor_in_m_5)
pts_by_floor_13 = PtsByFloor(flatten(pts_by_floor_11))
mindex_3 = MemberIndex(Set=node_num_by_floor_5, Member=node2_9)  # -> flatten(Index), Count
index = DataDescription(mindex_2.Index)
index_2 = DataDescription(mindex_3.Index)
item_18 = ListItem(List=pts_by_floor_12, Index=index, Wrap=True)  # -> graft(Item)
item_19 = ListItem(List=pts_by_floor_13, Index=index_2, Wrap=True)  # -> graft(Item)
ln = Line(StartPoint=item_18, EndPoint=item_19)
node_domains_6 = NodeDomains(node_domains_5)
beam_frame = BeamNum(ln)
beam_num_11 = BeamNum(beam_num)
profile_2 = Profile(profile)
beam_num_12 = BeamNum(beam_num_10)
mindex_4 = MemberIndex(Set=flatten(beam_num_12), Member=beam_num_11)  # -> flatten(Index), Count
displ_of_each_floor_in_m_7 = DisplOfEachFloorInMm(displ_of_each_floor_in_m_6)
beam_frame_2 = BeamFrame(flatten(beam_frame))
displ_2 = XDispl(displ)
profile_3 = Profile(profile_2)
index_3 = DataDescription(mindex_4.Index)
item_20 = ListItem(List=beam_frame_2, Index=index_3, Wrap=True)  # -> simplify(graft(Item))
abs = Absolute(Value=displ_2)
ggsp = GgSearchProfile(Pattern=profile_3)
abs_2 = Absolute(Value=displ_of_each_floor_in_m_7)  # -> flatten(Result)
node_domains_7 = NodeDomains(node_domains_6)
pdecon_3 = Deconstruct(Point=abs)  # -> XComponent, YComponent, ZComponent
bnd = Bounds(Numbers=abs_2)
beam_frame_3 = BeamFrame(item_20)
ggsweep = GgSweepProfile(Rail=item_20, Profile=ggsp, Cardinal=5)
x_displ_2 = XDispl(pdecon_3.XComponent)
dedomain = DeconstructDomain(Domain=bnd)  # -> Start, End
sections = DataDescription(ggsweep)
midpt = CurveMiddle(Curve=flatten(beam_frame_3))
upper_limit = DataDescription(dedomain.End)
lower_limit = DataDescription(dedomain.Start)
mesh = MeshBrep(
    Brep=sections,
    Settings={GridMaxCount=0, GridMinCount=16, JaggedSeams=False, MaxEdgeLength=0, MinEdgeLength=0.0001, MinTolerance=0, Refine=False, RefineAngle=0, RelativeTolerance=0.65, SimplePlanes=True, Tolerance=0})
pdecon_4 = Deconstruct(Point=midpt)  # -> XComponent, YComponent, ZComponent
mesh_section = DataDescription(mesh)
inc_2 = Includes(Value=flatten(pdecon_4.ZComponent), Domain=graft(node_domains_7))  # -> Includes, Deviation
beam_frame_4 = BeamFrame(beam_frame_3)
gradient = Gradient(
    LowerLimit=lower_limit,
    UpperLimit=upper_limit,
    Parameter=x_displ_2,
    stops=[0: RGB(34, 11, 154), 0.111: RGB(71, 48, 120), 0.274: RGB(0, 128, 0), 0.437: RGB(128, 255, 128), 0.643: RGB(255, 255, 0), 0.875: RGB(255, 128, 0), 1: RGB(255, 0, 0)])
beam_frame_5 = BeamFrame(beam_frame_4)
in_domain_3 = InDomain(inc_2.Includes)
mesh_section_2 = MeshSection(mesh_section)
mesh_section_3 = MeshSection(mesh_section_2)
dispatch_4 = Dispatch(List=flatten(beam_frame_5), DispatchPattern=in_domain_3)  # -> ListA, ListB
in_domain_4 = InDomain(in_domain_3)
dispatch_5 = Dispatch(List=flatten(mesh_section_3), DispatchPattern=in_domain_4)  # -> ListA, ListB
beam_frame_by_floor = BeamFrame(dispatch_4.ListA)
sections_frame_by_floor = BeamFrame(dispatch_5.ListA)
preview = CustomPreview(Geometry=sections_frame_by_floor, Material=gradient)
